# Grasshopper definition reverse cam.gh (Grasshopper 1.0.7)

divide_curve = DivideCurve(Curve=<geometry referenced from the Rhino model>, Count=100, Kinks=False)  # -> Points, Tangents, Parameters
split_list = SplitList(List=divide_curve.Points, Index=10)  # -> ListA, ListB
vector_2pt = Vector2Pt(PointA=Point(0, 0, 0), PointB=split_list.ListB, Unitize=False)  # -> Vector, Length
distance = Distance(PointA=Point(0, 0, 0), PointB=split_list.ListB)
angle = Angle(VectorA=Vector(87, 0, 0), VectorB=vector_2pt.Vector)  # -> Angle, Reflex
panel = Panel(distance)
panel_2 = Panel(angle.Angle)
